# Dynamo custom node ConnectPoints.dyf
# category: Revit

refPts = Input()
list_length = Length(refPts)
number = DoubleInput(2)
less_than = LessThan(list_length, number)
empty_list = Empty()
take_from_list = TakeList(number, refPts)
boolean = BoolSelector(true)
curve_by_points = CurveByPoints(take_from_list, boolean, lacing=Longest)
list_rest = Rest(refPts)
connectPoints = Custom[ConnectPoints](refPts=list_rest)
make_pair = List(curve_by_points, connectPoints)
if_ = Conditional(less_than, empty_list, make_pair)
