# Dynamo graph Autodesk.DesignScript.Geometry.NurbsCurve.PeriodicControlPoints.dyn (Dynamo 4.1.0.4124)

code_block = CodeBlock()
# ---------- code_block.designscript (5 lines) ----------
p1 = Point.ByCoordinates(0, 0);
p2 = Point.ByCoordinates(10, 10);
p3 = Point.ByCoordinates(20, 0);
p4 = Point.ByCoordinates(10, -10);
[p1,p2,p3,p4];
# ----------------------------------------
code_block_2 = CodeBlock(pts=code_block.out4) { nc = NurbsCurve.ByPoints(pts, true); }
isPeriodic = NurbsCurve.IsPeriodic(nurbsCurve=code_block_2)
periodicControlPoints = NurbsCurve.PeriodicControlPoints(nurbsCurve=code_block_2)
watch = Watch(periodicControlPoints)
controlPoints = NurbsCurve.ControlPoints(nurbsCurve=code_block_2)
watch_2 = Watch(controlPoints)
