# Dynamo graph graph function and connect points.dyn

number = DoubleInput(-1)
π = Pi()
multiplication = Multiplication(number, π)
number_2 = DoubleInput(32)
division = Division(π, number_2)
sine = Sin()
graphFunction = Custom[GraphFunction](x_start=multiplication, x_end=π, x_step=division, y=sine)
reference_point = ReferencePointByXYZ(graphFunction, lacing=Longest)
watch = Watch(reference_point)
connectPoints = Custom[ConnectPoints](refPts=reference_point)
