# Dynamo graph connect two point arrays.dyn

curve_by_selection = CurvesBySelection()  # 1 picked in the model
number_slider = DoubleSliderInput(4.761904762, range=0..20)
xyz_array_along_curve = XYZArrayAlongCurve(curve_by_selection, number_slider)
reference_point = ReferencePointByXYZ(xyz_array_along_curve)
curve_by_selection_2 = CurvesBySelection()  # 1 picked in the model
xyz_array_along_curve_2 = XYZArrayAlongCurve(curve_by_selection_2, number_slider)
reference_point_2 = ReferencePointByXYZ(xyz_array_along_curve_2)
list = NewList(item_s=reference_point, index1=reference_point_2, index2=number_slider)
watch = Watch(list)
python_script = Python(list)
# ---------- python_script.python (22 lines) ----------
import math

doc = __revit__.ActiveUIDocument.Document
app = __revit__.Application

RefPointList1 = IN[0]
RefPointList2 = IN[1]
count = IN[2] 

max = int(count)

#use for loop to connect two series of points
#if count > len(RefPointList1):
max = len(RefPointList1)

for i in range(0,max):
    pt1 = RefPointList1[i]
    pt2 = RefPointList2[i]
    refptarr = ReferencePointArray()
    refptarr.Append(pt1)
    refptarr.Append(pt2)
    crv = doc.FamilyCreate.NewCurveByPoints(refptarr)
# ----------------------------------------
transaction = Transaction(python_script)
