# Dynamo graph Indexed Family Instances.dyn (Dynamo 0.7.0.15504)

number = DoubleInput(0)
number_2 = DoubleInput(1)
number_slider = DoubleSliderInput(20, range=0..20)
number_3 = DoubleInput(1)
number_range = NumberRange(number_2, number_slider, number_3, lacing=Longest)
list_length = Length(number_range)
number_sequence = NumberSeq(number, list_length, number, lacing=Longest)
XYZ = Xyz(number_sequence, lacing=Longest)
select_family_type = FamilyTypeSelector(index=4)
create_family_instance = FamilyInstanceCreatorXyz(XYZ, select_family_type, lacing=Longest)
string = StringInput("increment")
set_family_instance_parameter = FamilyInstanceParameterSetter(create_family_instance, string, number_range, lacing=Longest)
