# Dynamo graph Dynamic Relaxation.dyn

number = DoubleInput(1)
select_point = PointBySelection()  # 1 picked in the model
select_point_2 = PointBySelection()  # 1 picked in the model
list = NewList(item_s=select_point, index1=select_point_2)
number_2 = DoubleInput(10)
number_3 = DoubleInput(1)
number_4 = DoubleInput(1)
number_5 = DoubleInput(10)
number_6 = DoubleInput(10)
number_7 = DoubleInput(-9.8)
create_particle_system = DynamicRelaxation(list, number_2, number_3, number_4, number_5, number_6, number_6, number_7)
number_8 = DoubleInput(0.5)
number_9 = DoubleInput(1)
execution_interval = ExecuteInterval(number_9)
dynamic_relaxation_step = DynamicRelaxationStep(create_particle_system, number_8, execution_interval)
get_from_list = GetFromList(number, dynamic_relaxation_step)
number_10 = DoubleInput(0)
get_from_list_2 = GetFromList(number_10, dynamic_relaxation_step)
watch_3d = Watch3D(get_from_list_2)
watch = Watch(create_particle_system)
