# Dynamo graph CSV to Stuff.dyn

family_type_selector = FamilyTypeSelector(index=5)
# note: connect Watch 3d to these
# to make Revit Stuff
family_instance_creator = FamilyInstanceCreatorXYZ(arg1=family_type_selector)
reference_point = ReferencePointByXYZ()
filename = StringFilename("C:\Autodesk\16 CSV to Points\helix_smaller.csv")
read_file = FileReader(filename)
# note: Readfile, String, Split String, and Parse List of Lists
# Can be made into a single file.  See 02 file.
string = StringInput("%0a")
split_string = SplitString(read_file, string)
number_slider = DoubleSliderInput(12.72775603, range=0..100)
parse_list_of_lists = Custom[Parse List of Lists](list=split_string, multiplier=number_slider)
watch_3d = dyn3DPreview(parse_list_of_lists)
watch = Watch(parse_list_of_lists)
