# Dynamo graph tesselation with coincident grids.dyn

face_by_selection = FormElementBySelection()  # 1 picked in the model
evaluate_uv = XYZEvaluate(arg1=face_by_selection)
surface_domain = SurfaceDomain(face_by_selection)
number_slider = DoubleSliderInput(6.515151515, range=0..20)
uv_grid = UVGrid(surface_domain, number_slider, number_slider)
map = Map(evaluate_uv, uv_grid)
# note: Wiggle Sliders
# for Awesome
number_slider_2 = DoubleSliderInput(14.24242424, range=0..20)
uv_grid_2 = UVGrid(surface_domain, number_slider_2, number_slider_2)
append = Append(uv_grid, uv_grid_2)
delaunay_tessellation = DelaunayTessellation(append, face_by_selection)
list = NewList(item_s=map, index1=delaunay_tessellation)
watch_3d = dyn3DPreview(list)
curve_by_points_by_line = CurveByPointsByLine()
