# Dynamo graph Adaptive Component Placement.dyn (Dynamo 0.6.2.14024)

select_curve = CurvesBySelection()  # 1 picked in the model
select_curve_2 = CurvesBySelection()  # 1 picked in the model
select_curve_3 = CurvesBySelection()  # 1 picked in the model
list = NewList(index0=select_curve, index1=select_curve_2, index2=select_curve_3)
number_slider = DoubleSliderInput(8.787, range=0..20)
xyz_array_on_curve = XyzArrayAlongCurve(list, number_slider, lacing=Longest)
transpose_lists = Transpose(xyz_array_on_curve)
select_family_type = FamilyTypeSelector(index=1)
adaptive_component_by_xyzs = AdaptiveComponentByPoints(transpose_lists, select_family_type, lacing=Longest)
hermite_spline = HermiteSpline(transpose_lists, lacing=Longest)
watch_3d = Watch3D(hermite_spline)
