# Dynamo graph Basics_Basic03.dyn (Dynamo 0.9.0.3067)

# note: Lists of Data can be generated with sequences and ranges.  These lists can be reorganized with many other nodes for specific purposes
number = DoubleInput(0)
number_2 = DoubleInput(9)
number_3 = DoubleInput(1)
range = Range(start=number, end=number_2, step=number_3, lacing=Longest)
watch = Watch(range)
number_4 = DoubleInput(3)
chop = List.Chop(range, number_4)
watch_2 = Watch(chop)
lastItem = List.LastItem(range)
watch_3 = Watch(lastItem)
