# Dynamo graph Defect_MAGN_3726.dyn (Dynamo 0.7.4.3200)

number = DoubleInput(0..54..10)
fromObject = String.FromObject(number)
string = StringInput("a")
concat = String.Concat(arg1=string)
map = List.Map(fromObject, concat)
