# Dynamo graph BSplineCurveTest.dyn (Dynamo 0.6.3.25915)

number = DoubleInput(1..5)
number_2 = DoubleInput(0)
point = Point3DNode(number, number, number_2, lacing=CrossProduct)
BSplineCurve = BSplineCurveNode(point, lacing=Longest)
watch_3d = Watch3D(BSplineCurve)
