# Dynamo graph RebindingMultiDimension.dyn (Dynamo 0.8.1.1151)

number = DoubleInput(0..5)
code_block = CodeBlock(base1=number, base2=number) { "example"+base1<1>+base2<2>; }
byString = SampleLibraryZeroTouch.TraceExampleWrapper.ByString(code_block)
