# Dynamo graph CBN_geometry.dyn (Dynamo 2.0.0.4093)

code_block = CodeBlock { h=1; }
code_block_2 = CodeBlock(k=code_block) { ll=k+2; }
code_block_3 = CodeBlock(v=code_block_2) { hf=v+2; }
code_block_4 = CodeBlock(a45=code_block_3) { vv=Point.ByCoordinates(a45,3,1); }
X = Point.X(code_block_4)
