# Dynamo graph dsfunctions.dyn (Dynamo 0.6.3.18405)

number = DoubleInput(0)
count = DSFunction(number)
add = DSFunction(number, number)
mul = DSFunction()
cos = DSFunction(number)  # "Math.Cos"
PI = DSFunction()  # "Math.PI"
byCoordinates = Point.ByCoordinates(number, number, number)
X = DSFunction(byCoordinates)  # "Point.X"
