# Dynamo graph HammersmithExcelFile_Open.dyn (Dynamo 0.6.3.32432)

file_path = StringFilename("..\..\..\test\core\excel\Hammersmith_Copy.csv")
open_excel_workbook = ReadExcelFile(file_path)
string = StringInput("Hammersmith_Copy")
get_excel_worksheet_by_name = GetExcelWorksheetByName(open_excel_workbook, string)
get_data_from_excel_worksheet = GetDataFromExcelWorksheet(get_excel_worksheet_by_name)
