# Dynamo graph TestExportToCSVFile.dyn (Dynamo 0.7.1.23670)

file_path = Filename("No file selected.")
code_block = CodeBlock { {{1,2,3,4,5},{-2,2.6,9},{0}}; }
exportToCSV = File.ExportToCSV(file_path, code_block)
