# Dynamo graph ShiftListIndeces_InputStringAsAmt.dyn (Dynamo 0.7.0.35153)

string = StringInput("Dynamo")
number = DoubleInput(1..10)
shift_list_indeces = ShiftList(string, number)
watch = Watch(shift_list_indeces)
