# Dynamo graph ShiftListIndeces_SimpleTest.dyn (Dynamo 0.7.0.35153)

number = DoubleInput(4)
number_2 = DoubleInput(1..10)
shift_list_indeces = ShiftList(number, number_2)
watch = Watch(shift_list_indeces)
