# Dynamo graph testTransposeList_normalInput.dyn (Dynamo 0.6.2.14024)

string = StringInput("AB")
string_2 = StringInput("CD")
list = NewList(index0=string, index1=string_2)
number = DoubleInput(21..24)
number_2 = DoubleInput(31..33)
list_2 = NewList(index0=list, index1=number, index2=number_2)
transpose_lists = Transpose(list_2)
watch = Watch(transpose_lists)
watch_2 = Watch(list_2)
