# Dynamo graph PythonCustomNodeHomeWorkspace.dyn (Dynamo 2.7.0.8544)

number_slider = DoubleSlider(89.3, range=0..100 step 0.1)
pythonCustomNodeTest = Custom[PythonCustomNodeTest](IN=number_slider)  # test python in a custom node
watch = Watch(pythonCustomNodeTest)
