# Dynamo graph serialization.dyn (Dynamo 1.2.1.2717)

# group: This is a group.
number = DoubleInput(5)
number_slider = DoubleSlider(3, range=0..100 step 0.1)

add = number + number_slider
code_block = CodeBlock { a=42.0; b=cat; }  # unwired: cat
