# Dynamo graph TestNumberToString_fromFunction.dyn

number = DoubleInput(12)
number_2 = DoubleInput(13)
add = Addition(number, number_2, lacing=Longest)
number_to_string = Num2String(add, lacing=Longest)
watch = Watch(number_to_string)
