# Dynamo graph ASM_points.dyn (Dynamo 0.7.0.41700)

code_block = CodeBlock { 0..5; }
number = DoubleInput(0)
byCoordinates = Point.ByCoordinates(code_block, number, number)
watch_3d = Watch3D(byCoordinates)
