# Dynamo graph ASM_python.dyn (Dynamo 0.7.0.24496)

python_script = Python()
# ---------- python_script.python (11 lines) ----------
import clr
clr.AddReference('ProtoGeometry')
from Autodesk.DesignScript.Geometry import *

pts = []

for i in range (0,10):
	for j in range (0,10):
		for k in range (0,10):
			pts.append(Point.ByCoordinates(i,j,k))
OUT = pts
# ----------------------------------------
watch = Watch(python_script)
