# Dynamo custom node Points.dyf (Dynamo 0.7.0.22310)
# category: Ian

number_of_points = Input()
number = DoubleInput(0..a, number_of_points, lacing=Longest)
point = Point3DNode(number, number, number, lacing=CrossProduct)
xyz = Output(point)
