# Dynamo graph CurveParameterAtPointQA_2.7.0_1.dyn (Dynamo 2.12.0.4265)

file_path = Filename("data\test_data_CurveParameterAtPoint.csv")

# group: Process data from excel
code_block = CodeBlock { true; }

importCSV = Data.ImportCSV(filePath=file_path, transpose=code_block)

# group (continued): Process data from excel
code_block_2 = CodeBlock(ls=importCSV) { ls1=List.DropItems(ls,1); List.Transpose(ls1); }
code_block_3 = CodeBlock(ls=code_block_2.out1) { station=ls[0]; x=ls[1]; y=ls[2]; z=ls[3]; r=ls[4]; cvType=ls[5]; cvSide=ls[6]; e=ls[7]; }
code_block_4 = CodeBlock(lsx=code_block_3.x, lsy=code_block_3.y, z=code_block_3.z) { x0=List.MinimumItem(lsx); y0=List.MinimumItem(lsy); x=lsx-x0; y=lsy-y0; z; }

# group: Geometry calculation
byCoordinates = Point.ByCoordinates(x=code_block_4.x, y=code_block_4.y, z=code_block_4.z)
pruneDuplicates = Point.PruneDuplicates(points=byCoordinates)

# group: Testing
boolean = BoolSelector(false)
byPoints = PolyCurve.ByPoints(points=pruneDuplicates, connectLastToFirst=boolean)
parameterAtPoint = Curve.ParameterAtPoint(curve=byPoints, point=pruneDuplicates)
planeAtParameter = Curve.PlaneAtParameter(curve=byPoints, param=parameterAtPoint)
toCoordinateSystem = Plane.ToCoordinateSystem(plane=planeAtParameter)
